# Dynamo graph stand.dyn (Dynamo 0.9.0.3067)

number = DoubleInput(0)
number_2 = DoubleInput(90)
create = List.Create(number, number_2)
number_3 = DoubleInput(10)
number_4 = DoubleInput(1)
byLengths = Cuboid.ByLengths(width=number_3, length=number_3, height=number_4)
origin = Point.Origin()
YAxis = Vector.YAxis()
number_5 = DoubleInput(45)
rotate = Geometry.Rotate(geometry=byLengths, origin=origin, axis=YAxis, degrees=number_5)
ZAxis = Vector.ZAxis()
code_block = CodeBlock { 0..#10..3; }
translate = Geometry.Translate(geometry=rotate, direction=ZAxis, distance=code_block)
rotate_2 = Geometry.Rotate(geometry=translate, origin=origin, axis=ZAxis, degrees=number_2)
intersect = Geometry.Intersect(geometry=rotate_2, other=translate)
